# Grasshopper definition basic.gh (Grasshopper 1.0.7)
# plug-ins: SimScale 

# ----
# Toggle to start
# downloading results
toggle = BooleanToggle(False)

# ----
# SimScale Project,
# Simulation and Run
panel = Panel("Run 1")

download = DownloadAndProcessResults(ProjectName="Boston - WCD 2022", SimulationName="Design 1", SimulationRunName=panel, Run=toggle)

# ----
# Reduce visulisation
# resolution
# CFD requires a level of resolution to get
# accuracy, the accuracy does not need to
# be carried forward in visulisation or for
# calulation of Outdoor Thermal Comfort
# Parameters, therefore,  we can reduce
# the comfort plot resolution to a defined
# value. 5, means 5 meters, one point,
# every 5 meters.
panel_2 = Panel("5")
reducemesh = ReduceMesh(SimScaleObject=download, TargetResolution=panel_2)

# ----
# Directions are rounded to the nearest CFD
# direction, speed is in m/s. Dimensionless
# speed is given by inputting 1m/s.
panel_3 = Panel("210")

# ----
# Direction selection and
# speed scaling
speeds = CollectWindSpeeds(SimScaleObject=reducemesh, WindDirection=panel_3, SpeedMultiplier="1")  # -> SimScaleObject, OutPath

# ----
# Visulisation
# Read in the different fields,
# for now, there is only one
# field, but in the future, there
# will be more
resultnames = GetResultNames(VTUFilePath=speeds.OutPath)

# ----
# Select the field to use
panel_4 = Panel("0")
item = ListItem(List=resultnames, Index=panel_4, Wrap=True)

# ----
# Read the file and convert
# to a Rhino mesh
convert = VTUToRhinoMesh(VTUFilePath=speeds.OutPath, Field=item)  # -> Mesh, DataValues

# ----
# Finally, visulise using the Ladybug tools
# Heatmap, update this with your version,
# since you may be using a different version
# than my 1.5.
heatmap = LBSpatialHeatmap(values=convert.DataValues, mesh=convert.Mesh, legend_title=item)  # -> mesh, legend, title, colors, legend_par; plug-in component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
