# Grasshopper definition basic_humantosky_example.gh (Grasshopper 1.0.7)
# plug-ins: SimScale 

# ----
# Define the results to download
# this is best copied and pasted
# from the SimScale workbench
# since this is case sensitive
panel = Panel("Run 1")
download = DownloadAndProcessResults(ProjectName="Boston - WCD 2022", SimulationName="Design 1", SimulationRunName=panel, Run=Toggle(False))

# ----
# To start the processing specific to a location,
# we need to supply a relevant epw file, in this
# case we supply a link and Ladybug tools
# does the rest for us.
panel_2 = Panel("https://climate.onebuilding.org/WMO_Region_4_North_and_Central_America/USA_United_States_of_America/MA_Massachusetts/USA_MA_Boston-Logan.Intl.AP.725090_TMYx.2009-2023.zip")
# Import weather Data
downloadepw = LBDownloadWeather(weather_URL=panel_2)  # -> epw_file, stat_file, ddy_file; plug-in component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
importepw = LBImportEPW(epw_file=downloadepw.epw_file)  # -> location, dry_bulb_temperature, dew_point_temperature, relative_humidity, wind_speed, wind_direction, direct_normal_rad, diffuse_horizontal_rad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; plug-in component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

# ----
# Reduce the mesh
# to save local
# computational cost
# when calulating
# the UTCI pipeline
panel_3 = Panel("5")
# SimScale Download Pipeline
reducemesh = ReduceMesh(SimScaleObject=download, TargetResolution=panel_3)

# ----
# After importing the base data, we need to
# supply a value for average speed and a
# direction, for this we use prevailing direction
# from the wind rose, and average speed from
# the EPW. The user is welcome to add
# periodic filtering as needed for their cases.
xdata = LBDeconstructData(data=importepw.wind_speed)  # -> header, values; plug-in component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
windrose = LBWindRose(data=importepw.wind_speed, wind_direction=importepw.wind_direction)  # -> report, mesh, compass, orient_line, freq_line, windrose_line, legend, title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; plug-in component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
avr = Average(Input=flatten(xdata.values))
item = ListItem(List=windrose.prevailing, Index=0, Wrap=True)

# ----
# Select and or scale the results
# from simScale from a PWC
# simulation. We need to provide
# a reference speed and direction.
# I usually do this using data from
# a Ladybug tools wind rose and
# EPW file.
speeds = CollectWindSpeeds(SimScaleObject=reducemesh, WindDirection=item, SpeedMultiplier=avr)  # -> SimScaleObject, OutPath

# ----
# After the results have been pulled, we
# should select the correct one (this is
# currently speed only) and return the results
#  aligned to a mesh, allowing for visulisation.
resultnames = GetResultNames(VTUFilePath=speeds.OutPath)
item_2 = ListItem(List=resultnames, Index="0", Wrap=True)
convert = VTUToRhinoMesh(VTUFilePath=speeds.OutPath, Field=item_2)  # -> Mesh, DataValues

# ----
# By visulising the heat map (right click and
# prievew) we can directly see the speed
# results that we will use for later calulating
# UTCI using.
heatmap = LBSpatialHeatmap(values=convert.DataValues, mesh=convert.Mesh, legend_title=item_2)  # -> mesh, legend, title, colors, legend_par; plug-in component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

# ----
# The first thing to do
# when feeding the mesh
# from SimScale is to
# deconstruct it, to obtain
# positions for the Ladybug
# UTCI calulation pipeline
demesh = DeconstructMesh(Mesh=convert.Mesh)  # -> Vertices, Faces, Colours, Normals

# ----
# This example is much
# simplified, and used the
# human to sky relationship
# as a first step. Add the
# positions, geographical
# location, and the context
# in which to use.
toggle = BooleanToggle(False)
geo = Geometry([<mesh referenced from the Rhino model> x5000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])
# Ladybug Outdoor Thermal Comfort Pipeline
humantosky = LBHumanToSkyRelation(location=importepw.location, position=flatten(demesh.Vertices), context=flatten(geo), height="0", run=toggle)  # -> report, human_points, human_line, fract_body_exp, sky_exposure; plug-in component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

# ----
# Outdoor solar MRT determines
# the percieved temperature caused
# by radiation from multiple sources
# and will later be used to calulate the
# final UTCI value, it feeds from the
# EPW file and the human to sky
# relationshps just calulated.
toggle_2 = BooleanToggle(False)
outdoorsolarmrt = LBOutdoorSolarMRT(
    location=importepw.location,
    surface_temp=importepw.dry_bulb_temperature,
    dir_norm_rad=importepw.direct_normal_rad,
    diff_horiz_rad=importepw.diffuse_horizontal_rad,
    horiz_infrared=importepw.horizontal_infrared_rad,
    sky_exposure=humantosky.sky_exposure,
    run=toggle_2)  # -> report, short_erf, long_erf, short_dmrt, long_dmrt, mrt; plug-in component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

# ----
# This final step calulates the
# UTCI values, drawing from
# the SimScale windspeeds
# (spatially varying) the MRT
# (spatially varying) and the
# uniform humidity and air
# temperature values taken
# from the EPW file.
toggle_3 = BooleanToggle(False)
utci = LBUTCIComfort(
    air_temp=importepw.dry_bulb_temperature,
    mrt=outdoorsolarmrt.mrt,
    rel_humid=importepw.relative_humidity,
    wind_vel=convert.DataValues,
    run=toggle_3)  # -> report, utci, comfort, condition, category, comf_obj; plug-in component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

# ----
# This is the fun part!
# Here we visulise the
# spatially varing UTCI
# results in Rhino.
xdata_2 = LBDeconstructData(data=utci.utci)  # -> header, values; plug-in component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
avr_2 = Average(Input=xdata_2.values)  # -> flatten(ArithmeticMean)
item_3 = ListItem(List=xdata_2.header, Index=0, Wrap=True)
heatmap_2 = LBSpatialHeatmap(values=avr_2, mesh=convert.Mesh, legend_title=item_3)  # -> mesh, legend, title, colors, legend_par; plug-in component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
